# Grasshopper definition planar_arch_generator.ghx (Grasshopper 1.0.7)
# plug-ins: Anemone

angle = Slider(20, range=0..45)
width = Slider(10, range=0..10)
aspect_ratio = Slider(0.6, range=0.1..2)

pt = ConstructPoint(XCoordinate="4.1", YCoordinate="1.7", ZCoordinate="-0.2")

# ----
# SINGLE ARCH
division = Division(A=graft(width), B=2)
rad = Radians(Degrees=graft(angle))
multiplication = Multiplication(A=division, B=graft(aspect_ratio))
X = UnitX(Factor=expr("-x", division))
Z = UnitZ(Factor=multiplication)
X_2 = UnitX(Factor=division)
move = Move(Geometry=pt, Motion=Z)  # -> Geometry, Transform
X_3 = UnitX(Factor=-1)
move_2 = Move(Geometry=pt, Motion=[X_2, X])  # -> Geometry, Transform
rot3d = Rotate3D(Geometry=move.Geometry, Angle=rad, Center=pt, Axis=X_3)  # -> Geometry, Transform
item = ListItem(List=move_2.Geometry, Index=0, Wrap=True)  # -> Item, Item1
merge = Merge(Data1=item.Item, Data2=rot3d.Geometry, Data3=item.Item1)

list = ValueList({"0 degrees": 0, "15 degrees": 15, "30 degrees": 30, "45 degrees": 45}, selected="0 degrees")
span = Panel("""2
3
4
5
6
7""")
aspect_ratio_2 = Panel("""0.25
0.50
0.75
1.00
1.25
1.50
1.75
2.00""")
panel = Panel("arch start point")
python = GhPythonScript(a=list)  # -> a_list
# ---------- python: Python ----------
__author__ = "Edvard"
__version__ = "2023.09.22"

import rhinoscriptsyntax as rs


a_list = [a,999999]

print a_list
# ---------- end python ----------
pt_2 = Point(pt)
python_2 = GhPythonScript(p=pt_2, angles=python, spans=span, ratios=aspect_ratio_2)  # -> simplify(points_out), simplify(variables_out); inputs p: Point3d, angles: list, spans: list, ratios: list
# ---------- python_2: Python ----------
__author__ = "Edvard"
__version__ = "2023.06.12"

import rhinoscriptsyntax as rs
import ghpythonlib.treehelpers as th
from Rhino.Geometry import Vector3d

import math
from copy import deepcopy

span_sublist = [[] for i in range(len(spans))]
point_sets = [deepcopy(span_sublist) for i in range(len(angles))]
data_sets = deepcopy(point_sets)

print point_sets


for i,angle in enumerate(angles):
    for j,span in enumerate(spans):
        for ratio in ratios:
            v1 = Vector3d(0,0,0)
            v2 = Vector3d(-span,0,0)
            
            #make end points
            p_start= rs.CopyObject(p,v1)
            p_end = rs.CopyObject(p,v2)
            
            height = (span/2)*ratio
            
            v3 = Vector3d(-span/2,0,height)
            p_mid = rs.CopyObject(p,v3)
            
            p_mid_new = rs.RotateObject(p_mid,p,angle,axis=Vector3d(-1,0,0),copy=True)
            
            point_set = [p_start, p_mid_new, p_end]
            point_sets[i][j].append(point_set)
            data_sets[i][j].append([angle,span,ratio])
            
            

#print point_sets
print data_sets
points_out = th.list_to_tree(point_sets)
variables_out = th.list_to_tree(data_sets)
# ---------- end python_2 ----------

# ----
# if TRUE then show all for variable
# no longer generate a 3D grid of points, just 2D. change the value of the angle manually. Keep the angle_idx at 0, otherwise it breaks something in "create arch curves"
span_idx = Slider(5, range=0..5)
ratio_idx = Slider(4, range=0..7)
python_3 = GhPythonScript(
    angle_idx=Slider(0, range=0..3),
    angle_filter=Toggle(False),
    span_idx=span_idx,
    span_filter=Toggle(True),
    ratio_idx=ratio_idx,
    ratio_filter=Toggle(False))  # -> out, path; inputs angle_idx: Int32, span_idx: Int32, ratio_idx: Int32
# ---------- python_3: Python ----------
__author__ = "Edvard"
__version__ = "2023.06.12"

import rhinoscriptsyntax as rs

if angle_filter:
    i = "?"
else:
    i = angle_idx
    

if span_filter:
    j = "?"
else:
    j = span_idx
    
    
if ratio_filter:
    k = "?"
else:
    k = ratio_idx
    

path = "{{{};{};{}}}".format(i,j,k)

print path
# ---------- end python_3 ----------

# ----
# Create a 3D grid of arch geometries
panel_2 = Panel(python_3.path)
viewer = ParamViewer(python_2.points_out)
split = SplitTree(Data=python_2.points_out, Masks=flatten(python_3.path))  # -> Positive, Negative
viewer_2 = ParamViewer(split.Positive)
split_2 = SplitTree(Data=python_2.variables_out, Masks=flatten(python_3.path))  # -> Positive, Negative

# ----
# old way to create curves (WRONG): create curve based on 3 points (start, middle, end)
pt_3 = Point(split.Positive)
intcrv = Interpolate(Vertices=pt_3, Degree=3, Periodic=False, KnotStyle=1)  # -> Curve, Length, Domain

# ----
# hard code the correct catenary curve for the 2m arch width at all the different rise/run ratios. These curves are then just scaled up by the ratio of the new arch spanto the original 2m span
panel_3 = Panel("0_2m_0.5")
panel_4 = Panel("0_2m_2.0")
panel_5 = Panel("0_2m_0.25")
panel_6 = Panel("0_2m_0.75")
panel_7 = Panel("0_2m_1.00")
panel_8 = Panel("0_2m_1.50")
crv = Curve(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)
crv_2 = Curve(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)
crv_3 = Curve(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)
crv_4 = Curve(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)
crv_5 = Curve(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)
crv_6 = Curve(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)

panel_9 = Panel("0_2m_1.75")
panel_10 = Panel("0_2m_1.25")
crv_7 = Curve(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)
crv_8 = Curve(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)

width_m = Panel("0.1125")
height_m = Panel("0.225")
thickness_m = Panel("0.075")
panel_11 = Panel("brick geometry")
division_2 = Division(A=thickness_m, B=2)
division_3 = Division(A=height_m, B=2)
division_4 = Division(A=width_m, B=2)

span_2 = Panel("2")
rise_to_run = Panel("1.75")
decimal_tolerance = Slider(8, range=0..10)
reset_loop = Button()
pt_4 = Point(pt)
data = Data(graft(span_2))
data_2 = Data(graft(rise_to_run))
division_5 = Division(A=data, B=2)
multiplication_2 = Multiplication(A=division_5, B=data_2)

# ---- group: Point A
pt_5 = Point(pt_4)

# ----
# SINGLE ARCH, SPECIFIED HEIGHT
vec = VectorXYZ(XComponent=expr("-x", span_2), YComponent=0, ZComponent=0)  # -> Vector, Length
set_high_number_of_iterations_just_in_ca = Slider(148, range=0..200)  # "(Set high number of iterations just in case)"
Z_2 = UnitZ(Factor=1)
decimal_tolerance_2 = Data(decimal_tolerance)
neg = Negative(Value=decimal_tolerance_2)
_10º = PowerOf10(Value=neg)
toelrance_display = Panel(_10º)

move_3 = Move(Geometry=pt_4, Motion=vec.Vector)  # -> Geometry, Transform

# ---- group: Point B
pt_6 = Point(move_3.Geometry)

# ----
pdecon = Deconstruct(Point=pt_6)  # -> XComponent, YComponent, ZComponent
avr = Average(Input=[pt_5, pt_6])
addition = Addition(A=pdecon.ZComponent, B=1)
pdecon_2 = Deconstruct(Point=avr)  # -> XComponent, YComponent, ZComponent
Z_3 = UnitZ(Factor=addition)
move_4 = Move(Geometry=avr, Motion=Z_3)  # -> Geometry, Transform

# ---- group: Get basic polyline length to get the result faster
merge_2 = Merge(Data1=pt_5, Data2=move_4.Geometry, Data3=pt_6)
pline = PolyLine(Vertices=merge_2, Closed=False)
len = Length(Curve=pline)

# ----
target_heights = Panel(multiplication_2)

addition_2 = Addition(A=pdecon_2.ZComponent, B=multiplication_2)
loop_start = LoopStart(Repeat=set_high_number_of_iterations_just_in_ca, Trigger=reset_loop, Data=len)  # -> port, Counter, Data
loop_counter = Panel(loop_start.Counter)
cat = Catenary(PointA=pt_5, PointB=pt_6, Length=loop_start.Data, Gravity=Z_2)

# ---- group: Create plane just above highest point to obtain highest point
pt_7 = ConstructPoint(XCoordinate=0, YCoordinate=0, ZCoordinate=Slider(100000, range=0..100000))
xy = XYPlane(Origin=pt_7)
project = Project(Geometry=cat, Plane=xy)  # -> Geometry, Transform

# ----
crvprox = CurveProximity(CurveA=cat, CurveB=project.Geometry)  # -> PointA, PointB, Distance
pdecon_3 = Deconstruct(Point=crvprox.PointA)  # -> XComponent, YComponent, expr("round(x,2)", ZComponent)
subtraction = Subtraction(A=addition_2, B=pdecon_3.ZComponent)
python_4 = GhPythonScript(x=subtraction, y=decimal_tolerance_2)  # -> out, value
# ---------- python_4: Python ----------
print x

value = round(x,int(y))
# ---------- end python_4 ----------
python_5 = GhPythonScript(x=loop_start.Data, y=_10º, z=python_4.value)  # -> a, b
# ---------- python_5: Python ----------
if z==0:
    a="True"
    b=x
else:
    a="False"
    b=x+(z/2)
__author__ = "Adwait"
__version__ = "2020.09.28"

import rhinoscriptsyntax as rs
# ---------- end python_5 ----------
loop_end = LoopEnd(port=loop_start.port, Exit=python_5.a, Data=python_5.b, TimeOutVal=0, pausedState=False, state="Constant output")
pt_8 = Point(crvprox.PointA)

data_3 = Data(flatten(pdecon_3.ZComponent))
subtraction_2 = Subtraction(A=data_3, B=pdecon_2.ZComponent)
resulting_heights = Panel(subtraction_2)

# ---- group: Final Catenary Curve
crv_9 = Curve(cat)

# ----
# Create arch curves
panel_12 = Panel("1")
item_2 = ListItem(List=split_2.Positive, Index=panel_12, Wrap=True)  # -> Item1, Item, Item1_2

arch_dims = Panel(split_2.Positive)
ratios = Panel(item_2.Item1_2)
spans = Panel(item_2.Item)

# ----
# choose which base 2m span curve to use
python_6 = GhPythonScript(
    x=item_2.Item1_2,
    line_025=crv_2,
    line_050=crv_3,
    line_075=crv_4,
    line_100=crv,
    line_125=crv_7,
    line_150=crv_5,
    line_175=crv_8,
    line_200=crv_6)  # -> out, test_out; inputs x: tree, line_025: Curve, line_050: Curve, line_075: Curve, line_100: Curve, line_125: Curve, line_150: Curve, line_175: Curve, line_200: Curve
# ---------- python_6: Python ----------
__author__ = "Edvard"
__version__ = "2023.09.21"

import rhinoscriptsyntax as rs
import ghpythonlib.treehelpers as th

import math
from copy import deepcopy

print x

test = deepcopy(x)
test = th.tree_to_list(x)
print 'TEST: ', test

for i,branch in enumerate(test):
    
    print 'branch', branch
    
    if branch:
        for j,item in enumerate(branch):
            
            print item
            
            if item:
                print int(float(item[0])*100)
                
                if int(float(item[0])*100) == 200:
                    test[i][j] = [line_200]
                elif int(float(item[0])*100) == 175:
                    test[i][j] = [line_175]
                elif int(float(item[0])*100) == 150:
                    test[i][j] = [line_150]
                elif int(float(item[0])*100) == 125:
                    test[i][j] = [line_125]
                elif int(float(item[0])*100) == 100:
                    test[i][j] = [line_100]
                elif int(float(item[0])*100) == 75:
                    test[i][j] = [line_075]
                elif int(float(item[0])*100) == 50:
                    test[i][j] = [line_050]
                elif int(float(item[0])*100) == 25:
                    test[i][j] = [line_025]
            
print test

test_out = th.list_to_tree(test)
# ---------- end python_6 ----------
data_4 = Data(python_6.test_out)
clean = CleanTree(RemoveNulls=True, RemoveInvalid=True, RemoveEmpty=True, Tree=data_4)

# ----
# scale up the base 2m curve by the correct arch span
division_6 = Division(A=item_2.Item, B=2)
pt_9 = Point(pt)
pl = ConstructPlane(Origin=pt_9, XAxis=Vector(1, 0, 0), YAxis=Vector(0, 1, 0))
scale_nu = ScaleNU(Geometry=clean, Plane=pl, ScaleX=division_6, ScaleY=1, ScaleZ=division_6)  # -> Geometry, Transform

viewer_3 = ParamViewer(scale_nu.Geometry)
crv_10 = Curve(scale_nu.Geometry)

X_4 = UnitX(Factor=expr("-x", 1))
rad_2 = Radians(Degrees=item_2.Item1)
pt_10 = Point(pt)
panel_13 = Panel("rotate the curves")
rot3d_2 = Rotate3D(Geometry=crv_10, Angle=rad_2, Center=pt_10, Axis=X_4)  # -> Geometry, Transform

crv_11 = Curve(rot3d_2.Geometry)
len_2 = Length(Curve=flatten(crv_11))
crv_12 = Curve(crv_11)
division_7 = Division(A=len_2, B=thickness_m)
int = Integer(graft(division_7))
divide = DivideCurve(Curve=crv_12, Count=int, Kinks=False)  # -> Points, Tangents, Parameters
shatter = Shatter(Curve=crv_12, Parameters=divide.Parameters)  # -> simplify(Segments)
midpt = CurveMiddle(Curve=shatter)
crv_cp = CurveClosestPoint(Point=midpt, Curve=crv_12)  # -> Point, Parameter, Distance
pframe = PerpFrame(Curve=crv_12, Parameter=crv_cp.Parameter)  # -> simplify(Frame)
prot = RotatePlane(Plane=pframe, Angle="pi/2")
pln = Plane(prot)

# ----
# draw brick volumes tangent to the curve. unique number of bricks per leg of arch.
# assign brick mesh to arch curve
box = CenterBox(Base=pln, X=division_3, Y=division_4, Z=division_2)
