# Grasshopper definition reachability_analysis_FORPAPER.ghx (Grasshopper 1.0.7)
# plug-ins: Karamba3D

# ----
# STEP 1: read in the saved reachability map results
file_name_aggregated_results = Panel("{}/_{}_TOTAL.json")
filename_single_vec_results = Panel("{}/{}_vec{:0>3}.json")
filename_output_reach_results = Panel("results_planar_arches")
n_vectors = Slider(100, range=1..100)
list = ValueList({"Robot 1": "rob1", "Robot 2": "rob2", "Robot 3": "rob3", "Robot 1&2": "rob1,rob2", "Robot 1&3": "rob1,rob3", "Robot 2&3": "rob2,rob3", "Robot 1&2&3": "rob1,rob2,rob3"}, selected="Robot 1&2")
list_2 = ValueList({"YES TRACK": "/Users/edvard/Documents/github/rob_fab_reach/_data_track", "NO TRACK": "/Users/edvard/Documents/github/rob_fab_reach/_data_notrack"}, selected="YES TRACK")

# ---- group: analysis output file
data = Data(list_2)
data_2 = Data(filename_output_reach_results)
python = GhPythonScript(x=data, y=data_2)  # -> path
# ---------- python: Python ----------
__author__ = "Edvard"
__version__ = "2023.06.19"

import rhinoscriptsyntax as rs
import os

path = os.path.join(x,y)
print path
# ---------- end python ----------
data_3 = Data(python)
panel = Panel(data_3)

# ----
# choose a subset of full arch geometry set to analyze
# if TRUE then show all for variable
# no longer generate a 3D grid of points, just 2D. change the value of the angle manually. Keep the angle_idx at 0, otherwise it breaks something in "create arch curves"
span_idx = Slider(4, range=0..5)
ratio_idx = Slider(7, range=0..7)
python_2 = GhPythonScript(
    angle_idx=Slider(0, range=0..3),
    angle_filter=Toggle(False),
    span_idx=span_idx,
    span_filter=Toggle(False),
    ratio_idx=ratio_idx,
    ratio_filter=Toggle(True))  # -> out, path; inputs angle_idx: Int32, span_idx: Int32, ratio_idx: Int32
# ---------- python_2: Python ----------
__author__ = "Edvard"
__version__ = "2023.06.12"

import rhinoscriptsyntax as rs

if angle_filter:
    i = "?"
else:
    i = angle_idx
    

if span_filter:
    j = "?"
else:
    j = span_idx
    
    
if ratio_filter:
    k = "?"
else:
    k = ratio_idx
    

path = "{{{};{};{}}}".format(i,j,k)

print path
# ---------- end python_2 ----------

# ----
# read in total results (for all 100 vecs)
toggle = BooleanToggle(True)
data_4 = Data(list_2)
data_5 = Data(file_name_aggregated_results)
data_6 = Data(list)
python_3 = GhPythonScript(path=data_4, name=data_5, rob_num=data_6, read_data=toggle)  # -> points, values, reach_coop_bools, reach_single_bools
# ---------- python_3: Python ----------
import os
import json
from compas_fab.utilities import read_data_from_json
from compas_fab.robots import Configuration

from copy import deepcopy
from collections import OrderedDict


"""
286,455 is the total number of points
for 3 robot work volume at 0.1m spacing
x: -3.2 --> 8.0
y: -1.5 --> 4.9
z: -0.4 --> 3.4
"""

"""
235,755 is the total number of points
for 2 robot work volume at 0.1m spacing
x: -3.2 --> 6.0
y: -1.5 --> 4.9
z: -0.4 --> 3.4
"""


def count_data(rob_num):
    count_total = OrderedDict() #keep them same order later when copying
    count_cooperative = OrderedDict()
    
    #read in data based on how many robots
    filepaths = [os.path.join(path, name.format(rob,rob)) for rob in rob_num]
    files = [open(filepath, "r") for filepath in filepaths]
    datas = [json.loads(file.read()) for file in files]
    
    for f in files:
        f.close()
    
    #initialize the dictionary, each unique point
    for data in datas:
        count_total.update(data['results'])
    
    #zero all the values in the dictionary
    for key in count_total:
        count_total[key] = 0
        
    count_cooperative = count_total.copy()
    
    #read in all data, sum in total count, sum in # robs reached
    for data in datas:
        for key,value in data['results'].items():
            
            if value:
                count_total[key] += value
                count_cooperative[key] += 1


    return count_total, count_cooperative



if read_data:
    rob_num = rob_num.split(",")
    
    count_total,count_cooperative = count_data(rob_num)
    
    reach_coop = deepcopy(count_cooperative)
    reach_single = deepcopy(count_cooperative)
    
#    if all_reach: #save points all can reach
    for key,value in reach_coop.items():
        if value == len(rob_num):
            reach_coop[key] = 1
        else:
            reach_coop[key] = 0
                
#    else: #save points at least one robot can reach
    for key,value in reach_single.items():
        if value == len(rob_num):
            reach_single[key] = 1
        
    
    points = count_total.keys()
    values = count_total.values()
    reach_coop_bools = reach_coop.values()
    reach_single_bools = reach_single.values()
# ---------- end python_3 ----------

# ----
# read in partial results (up to n_vec)
toggle_2 = BooleanToggle(False)
data_7 = Data(list_2)
data_8 = Data(filename_single_vec_results)
data_9 = Data(list)
data_10 = Data(n_vectors)
python_4 = GhPythonScript(path=data_7, name=data_8, rob_num=data_9, step_num=data_10, read_data=toggle_2)  # -> points, values, coop_points, simplify(vectors); inputs step_num: Int32
# ---------- python_4: Python ----------
import os
import json
from compas_fab.utilities import read_data_from_json
from compas_fab.robots import Configuration

import ghpythonlib.treehelpers as th

"""
243,360 is the total number of points
for 3 robot work volume at 0.1m spacing
x: -1.5 --> 8.0
y: -1.5 --> 4.9
z: -0.4 --> 3.4
"""

def initialize_count(rob_num):
    """return a dictionary full of 0s"""
    
    point_count = {}
    
    for rob in rob_num:
        filename = name.format(rob,rob,1) # just take first to init
        filepath = os.path.join(path, filename)
        
        with open(filepath, "r") as f:
            file_data = f.read()
            
        f.close()
        
        data = json.loads(file_data)
        point_count.update(data['results'])
        
        print len(point_count)
        
    for key in point_count:
        point_count[key] = 0
    
    return point_count

    

if read_data:
    
    rob_num = rob_num.split(",")
    
    point_count = initialize_count(rob_num)
    cooperative_count_save = point_count.copy()
    cooperative_count_zero = point_count.copy()
    vectors = []
    
        
    for i in range(1,step_num+1):
        
        # re-zero it
        cooperative_count = cooperative_count_zero.copy()

        for rob in rob_num:
            print "{}: vector {}".format(rob,i)
            
            filename = name.format(rob,rob,i)
            filepath = os.path.join(path, filename)
            
            with open(filepath, "r") as f:
                file_data = f.read()
                data = json.loads(file_data)
                f.close()
                
                vec = data['vector']
                vectors.append(vec)
            
            for pnt,result in data['results'].items():
                if result:
                    cooperative_count[pnt] += 1
                    point_count[pnt] += 1
                    
        #after all robs done
        #keep over-writing if already 1, then stays 1
        for pnt,result in cooperative_count.items():
            if result == len(rob_num):
                cooperative_count_save[pnt] = 1
            
    #output data
    vectors = th.list_to_tree(vectors, source=[0,0])
    points = point_count.keys()
    values = point_count.values()
    
    coop_points = cooperative_count_save.values()
# ---------- end python_4 ----------
num = Number(python_4.vectors)

# ----
# choose data
list_3 = ValueList({"From PARTIAL": 0, "From TOTAL": 1}, selected="From TOTAL")
filter = StreamFilter(Gate=list_3, Stream0=python_4.points, Stream1=python_3.points)
filter_2 = StreamFilter(Gate=list_3, Stream0=python_4.values, Stream1=python_3.values)
filter_3 = StreamFilter(Gate=list_3, Stream0=python_4.coop_points, Stream1=python_3.reach_coop_bools)
filter_4 = StreamFilter(Gate=list_3, Stream0=python_4.coop_points, Stream1=python_3.reach_single_bools)
int = Integer(filter_4)
pt = Point(filter)
int_2 = Integer(filter_2)
int_3 = Integer(filter_3)

# ----
# STEP 2: Process & vizualize reachable points dataset
# maximum reach count in data
data_11 = Data(list)
int_4 = Integer(int_2)
data_12 = Data(n_vectors)
values = GhPythonScript(rob_num=data_11, values=int_4, n_steps=data_12)  # -> max_index; inputs values: list, n_steps: Int32
# ---------- values: Python ----------
counts = []

rob_num = rob_num.split(",")

# maximum number of possible reaches per point
max = n_steps * len(rob_num)

# count how many times a number of reaches occurs
for i in range(0,max + 1):
    counts.append(values.count(i))

# what is the maximum number of reaches in whole volume
for i,cnt in enumerate(counts):
    if cnt:
        max_index = i

# for many points does maximum number of reaches occur
max_counts = counts[max_index]
# ---------- end values ----------
panel_2 = Panel(values)

# ----
# show all points
panel_3 = Panel("0")
panel_4 = Panel(panel_2)
gradient = Gradient(
    LowerLimit=panel_3,
    UpperLimit=panel_4,
    Parameter=int_2,
    stops=[0: RGB(255, 255, 255), 0.1: RGB(236, 27, 60), 0.2: RGB(210, 0, 118), 0.3: RGB(103, 0, 120), 0.4: RGB(39, 72, 161), 0.5: RGB(1, 192, 229), 0.6: RGB(18, 178, 90), 0.7: RGB(79, 186, 8), 0.8: RGB(220, 237, 32), 0.9: RGB(247, 159, 20), 1: RGB(243, 57, 0)])
gradient_2 = Gradient(
    LowerLimit=panel_3,
    UpperLimit=panel_4,
    Parameter=int_2,
    stops=[0: RGB(255, 255, 255), 0.8: RGB(255, 0, 0), 0.986: RGB(145, 0, 0), 1: RGB(0, 0, 0)])
preview = CustomPreview(Geometry=pt, Material=gradient)

# ----
# hard code the correct catenary curve for the 2m arch width at all the different rise/run ratios. These curves are then just scaled up by the ratio of the new arch spanto the original 2m span
panel_5 = Panel("0_2m_0.25")
panel_6 = Panel("0_2m_0.5")
panel_7 = Panel("0_2m_0.75")
panel_8 = Panel("0_2m_1.00")
panel_9 = Panel("0_2m_1.50")
panel_10 = Panel("0_2m_2.0")
crv = Curve(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)
crv_2 = Curve(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)
crv_3 = Curve(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)
crv_4 = Curve(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)
crv_5 = Curve(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)
crv_6 = Curve(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)

panel_11 = Panel("0_2m_1.25")
panel_12 = Panel("0_2m_1.75")
crv_7 = Curve(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)
crv_8 = Curve(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)

# ----
# show points where ALL robots can reach
dispatch = Dispatch(List=pt, DispatchPattern=int_3)  # -> ListA, ListB
dispatch_2 = Dispatch(List=int_2, DispatchPattern=int_3)  # -> ListA, ListB
panel_13 = Panel(panel_2)
gradient_3 = Gradient(
    LowerLimit="0",
    UpperLimit=panel_13,
    Parameter=dispatch_2.ListA,
    stops=[0: RGB(255, 255, 255), 0.1: RGB(236, 27, 60), 0.2: RGB(210, 0, 118), 0.3: RGB(103, 0, 120), 0.4: RGB(39, 72, 161), 0.5: RGB(1, 192, 229), 0.6: RGB(18, 178, 90), 0.7: RGB(79, 186, 8), 0.8: RGB(220, 237, 32), 0.9: RGB(247, 159, 20), 1: RGB(243, 57, 0)])
pt_2 = Point(dispatch.ListA)
preview_2 = CustomPreview(Geometry=pt_2, Material=gradient_3)

# ----
# show points where AT LEAST ONE robot can reach
dispatch_3 = Dispatch(List=pt, DispatchPattern=int)  # -> ListA, ListB
dispatch_4 = Dispatch(List=int_2, DispatchPattern=int)  # -> ListA, ListB
panel_14 = Panel(panel_2)
gradient_4 = Gradient(
    LowerLimit="0",
    UpperLimit=panel_14,
    Parameter=dispatch_4.ListA,
    stops=[0: RGB(255, 255, 255), 0.1: RGB(236, 27, 60), 0.2: RGB(210, 0, 118), 0.3: RGB(103, 0, 120), 0.4: RGB(39, 72, 161), 0.5: RGB(1, 192, 229), 0.6: RGB(18, 178, 90), 0.7: RGB(79, 186, 8), 0.8: RGB(220, 237, 32), 0.9: RGB(247, 159, 20), 1: RGB(243, 57, 0)])
pt_3 = Point(dispatch_3.ListA)
preview_3 = CustomPreview(Geometry=pt_3, Material=gradient_4)

width_m = Panel("0.1125")
height_m = Panel("0.225")
thickness_m = Panel("0.075")
# add brick geometry along the arch curve
panel_15 = Panel("brick geometry")
division = Division(A=thickness_m, B=2)
division_2 = Division(A=height_m, B=2)
division_3 = Division(A=width_m, B=2)

# ----
# cooperative reach points
# reach values at cooperative points
# single robot reach points
# reach values at single points
int_5 = Integer(dispatch_2.ListA)
# STEP 4: Perform reachability evaluation for given geometry and output results
pt_4 = Point(pt_2)
pt_5 = Point(dispatch_3.ListA)
int_6 = Integer(dispatch_4.ListA)

spring_kn_m_3 = Panel("100000000")
spring_kn_rad_m_3 = Panel("800000")
# Joints
arch_thickness_m = Panel(height_m)
arch_width_m = Panel(width_m)
multiplication = Multiplication(A=arch_thickness_m, B=arch_width_m)
panel_16 = Panel(multiplication)
multiplication_2 = Multiplication(A=multiplication, B=spring_kn_rad_m_3)
multiplication_3 = Multiplication(A=multiplication, B=spring_kn_m_3)
linear_stiffness_kn_m = Panel(multiplication_3)
rotational_stiffness_kn_rad = Panel(multiplication_2)
has_translation_spring = BooleanToggle(True)
has_rotation_spring = BooleanToggle(True)
num_2 = Number(multiplication_3)
num_3 = Number(multiplication_2)
python_5 = GhPythonScript(
    spring_translational_stiffness=num_2,
    spring_rotational_stiffness=num_3,
    has_translation_spring=has_translation_spring,
    has_rotation_spring=has_rotation_spring)  # -> out, ct, cr, dof; inputs has_translation_spring: Boolean, has_rotation_spring: Boolean
# ---------- python_5: Python ----------
import rhinoscriptsyntax as rs

dof = []

tras = spring_translational_stiffness
rots = spring_rotational_stiffness

if has_translation_spring:
    dof.extend(list(range(0, 3)))
    ct = rs.AddPoint(tras, tras, tras)
else:
    ct = rs.AddPoint(0, 0, 0)

if has_rotation_spring:
    dof.extend(list(range(3, 6)))
    cr = rs.AddPoint(rots, rots, rots)
else:
    cr = rs.AddPoint(0, 0, 0)
# ---------- end python_5 ----------
vec = Vector(python_5.ct)
int_7 = Integer(python_5.dof)
vec_2 = Vector(python_5.cr)

license = LicenseKaramba3D()
panel_17 = Panel(license)

int_8 = Integer(int_7)
vec_3 = Vector(vec)
vec_4 = Vector(vec_2)
beam_joints = BeamJointsKaramba3D(
    AtElementIdentifiers="bricks",
    CtKNMAtStartingNode=vec_3,
    CrKNmRadAtStartingNode=vec_4,
    CtKNMAtEndNode=vec_3,
    CrKNmRadAtEndNode=vec_4,
    DofsStart=int_8,
    DofsEnd=int_8,
    menu=[buttons(off, off, off, off, off, off), buttons(off, off, off, off, off, off)])
joint = JointKaramba3D(simplify(beam_joints))

# ----
# STEP 3: generate planar arch geometry to analyze
panel_18 = Panel("4.1")
pt_6 = ConstructPoint(XCoordinate=panel_18, YCoordinate="1.7", ZCoordinate="-0.2")
panel_19 = Panel(python_2.path)

# ----
# initialize a full set of geometries
list_4 = ValueList({"0 degrees": 0, "7.5 degrees": 7.5, "15 degrees": 15, "22.5 degrees": 22.5}, selected="0 degrees")
aspect_ratio = Panel("""0.25
0.50
0.75
1.00
1.25
1.50
1.75
2.00""")
span = Panel("""2
3
4
5
6
7""")
panel_20 = Panel("arch start point")
python_6 = GhPythonScript(a=list_4)  # -> a_list
# ---------- python_6: Python ----------
__author__ = "Edvard"
__version__ = "2023.09.22"

import rhinoscriptsyntax as rs


a_list = [a,999999]

print a_list
# ---------- end python_6 ----------
pt_7 = Point(pt_6)
python_7 = GhPythonScript(p=pt_7, angles=python_6, spans=span, ratios=aspect_ratio)  # -> simplify(points_out), simplify(variables_out); inputs p: Point3d, angles: list, spans: list, ratios: list
# ---------- python_7: Python ----------
__author__ = "Edvard"
__version__ = "2023.06.12"

import rhinoscriptsyntax as rs
import ghpythonlib.treehelpers as th
from Rhino.Geometry import Vector3d

import math
from copy import deepcopy

span_sublist = [[] for i in range(len(spans))]
point_sets = [deepcopy(span_sublist) for i in range(len(angles))]
data_sets = deepcopy(point_sets)

print point_sets


for i,angle in enumerate(angles):
    for j,span in enumerate(spans):
        for ratio in ratios:
            v1 = Vector3d(0,0,0)
            v2 = Vector3d(-span,0,0)
            
            #make end points
            p_start= rs.CopyObject(p,v1)
            p_end = rs.CopyObject(p,v2)
            
            height = (span/2)*ratio
            
            v3 = Vector3d(-span/2,0,height)
            p_mid = rs.CopyObject(p,v3)
            
            p_mid_new = rs.RotateObject(p_mid,p,angle,axis=Vector3d(-1,0,0),copy=True)
            
            point_set = [p_start, p_mid_new, p_end]
            point_sets[i][j].append(point_set)
            data_sets[i][j].append([angle,span,ratio])
            
            

#print point_sets
print data_sets
points_out = th.list_to_tree(point_sets)
variables_out = th.list_to_tree(data_sets)
# ---------- end python_7 ----------

viewer = ParamViewer(python_7.points_out)
split = SplitTree(Data=python_7.variables_out, Masks=flatten(python_2.path))  # -> Positive, Negative
viewer_2 = ParamViewer(split.Positive)

# ----
# Create catenary arch curves for analysis subset
panel_21 = Panel("1")
item = ListItem(List=split.Positive, Index=panel_21, Wrap=True)  # -> Item1, Item, Item1_2

# ----
# choose which base 2m span curve to use
python_8 = GhPythonScript(
    x=item.Item1_2,
    line_025=crv,
    line_050=crv_2,
    line_075=crv_3,
    line_100=crv_4,
    line_125=crv_7,
    line_150=crv_5,
    line_175=crv_8,
    line_200=crv_6)  # -> out, test_out; inputs x: tree, line_025: Curve, line_050: Curve, line_075: Curve, line_100: Curve, line_125: Curve, line_150: Curve, line_175: Curve, line_200: Curve
# ---------- python_8: Python ----------
__author__ = "Edvard"
__version__ = "2023.09.21"

import rhinoscriptsyntax as rs
import ghpythonlib.treehelpers as th

import math
from copy import deepcopy

print x

test = deepcopy(x)
test = th.tree_to_list(x)
print 'TEST: ', test

for i,branch in enumerate(test):
    
    print 'branch', branch
    
    if branch:
        for j,item in enumerate(branch):
            
            print item
            
            if item:
                print int(float(item[0])*100)
                
                if int(float(item[0])*100) == 200:
                    test[i][j] = [line_200]
                elif int(float(item[0])*100) == 175:
                    test[i][j] = [line_175]
                elif int(float(item[0])*100) == 150:
                    test[i][j] = [line_150]
                elif int(float(item[0])*100) == 125:
                    test[i][j] = [line_125]
                elif int(float(item[0])*100) == 100:
                    test[i][j] = [line_100]
                elif int(float(item[0])*100) == 75:
                    test[i][j] = [line_075]
                elif int(float(item[0])*100) == 50:
                    test[i][j] = [line_050]
                elif int(float(item[0])*100) == 25:
                    test[i][j] = [line_025]
            
print test

test_out = th.list_to_tree(test)
# ---------- end python_8 ----------
data_13 = Data(python_8.test_out)
clean = CleanTree(RemoveNulls=True, RemoveInvalid=True, RemoveEmpty=True, Tree=data_13)

# ----
# scale up the base 2m curve by the correct arch span
division_4 = Division(A=item.Item, B=2)
pt_8 = Point(pt_6)
pl = ConstructPlane(Origin=pt_8, XAxis=Vector(1, 0, 0), YAxis=Vector(0, 1, 0))
scale_nu = ScaleNU(Geometry=clean, Plane=pl, ScaleX=division_4, ScaleY=1, ScaleZ=division_4)  # -> Geometry, Transform

arch_dims = Panel(split.Positive)
ratios = Panel(item.Item1_2)
spans = Panel(item.Item)

X = UnitX(Factor=expr("-x", 1))
rad = Radians(Degrees=item.Item1)
pt_9 = Point(pt_6)
panel_22 = Panel("rotate the curves")
rot3d = Rotate3D(Geometry=scale_nu.Geometry, Angle=rad, Center=pt_9, Axis=X)  # -> Geometry, Transform

crv_9 = Curve(rot3d.Geometry)

# ----
# brick center planes
# plane for center of brick
crv_10 = Curve(crv_9)
len = Length(Curve=flatten(crv_10))
crv_11 = Curve(crv_10)
division_5 = Division(A=len, B=thickness_m)
int_9 = Integer(graft(division_5))
divide = DivideCurve(Curve=crv_11, Count=int_9, Kinks=False)  # -> Points, Tangents, Parameters
shatter = Shatter(Curve=crv_11, Parameters=divide.Parameters)  # -> simplify(Segments)
midpt = CurveMiddle(Curve=shatter)
crv_cp = CurveClosestPoint(Point=midpt, Curve=crv_11)  # -> Point, Parameter, Distance
pframe = PerpFrame(Curve=crv_11, Parameter=crv_cp.Parameter)  # -> simplify(Frame)
prot = RotatePlane(Plane=pframe, Angle="pi/2")
pln = Plane(prot)

# ----
# brick center points (rounded to nearest 0.1m)
pdecon = Deconstruct(Point=crv_cp.Point)  # -> XComponent, YComponent, ZComponent
expression = Expression(x=pdecon.XComponent, Expression="round(x,1)")
expression_2 = Expression(x=pdecon.YComponent, Expression="round(x,1)")
expression_3 = Expression(x=pdecon.ZComponent, Expression="round(x,1)")
pt_10 = ConstructPoint(XCoordinate=expression, YCoordinate=expression_2, ZCoordinate=expression_3)
pt_11 = Point(pt_10)

# ----
# arch dimensions
# arch brick locations
data_14 = Data(pt_11)
data_15 = Data(split.Positive)

data_16 = Data(data_3)
python_9 = GhPythonScript(
    output_path=data_16,
    reach_points_coop=pt_4,
    reach_values_coop=int_5,
    reach_points_single=pt_5,
    reach_values_single=int_6,
    arch_dims=data_15,
    arch_bricks=data_14,
    save_data=Toggle(False))  # -> out, output; inputs reach_points_coop: list of Point3d, reach_values_coop: list, reach_points_single: list of Point3d, reach_values_single: list, arch_dims: tree, arch_bricks: tree of Point3d
# ---------- python_9: Python ----------
__author__ = "Edvard"
__version__ = "2023.06.13"

import rhinoscriptsyntax as rs
import ghpythonlib.treehelpers as th

import os
import json

from collections import OrderedDict

def generate_filename(data):
    name = "a{:0>3}_s{:0>2}_r{:0>3}"
    
    angle = str(int(data["angle"]*10))
    span = str(data["span"]).replace('.','')
    ratio = str(int(round(data["ratio"]*100,0))).replace('.','')
    
    filename = name.format(angle,span,ratio)
    return filename

def save_json(dims,data):
    filename = generate_filename(dims)
    filepath = os.path.join(output_path, filename)
    
    with open(filepath, "w") as f:
        json.dump(data,f,indent=4)
        f.close()

def reach_counts(saved_reach_data,branch_list,reach_points,reach_values):
    
    n_total = len(branch_list)
    n_notreach = 0
    n_reach = 0
    value = 0
    
    for arch_point in branch_list:
        try:
            idx = reach_points.index(arch_point)
            value += reach_values[idx]
            
            n_reach += 1
        except:
            n_notreach += 1
            
    saved_reach_data["bricks_total"] = n_total
    saved_reach_data["bricks_reach"] = n_reach
    saved_reach_data["bricks_notreach"] = n_notreach
    saved_reach_data["reach_ratio"] = round(n_reach/n_total,2)
    saved_reach_data["avg_reach_score"] = int(round(value/n_total,0))
    
    return saved_reach_data

for i in range(arch_dims.BranchCount):
    
    saved_variables = OrderedDict()
    saved_reach_data1 = OrderedDict()
    saved_reach_data2 = OrderedDict()
    output = OrderedDict()
    
    saved_reach_data1 = reach_counts(
        saved_reach_data1,
        arch_bricks.Branch(i),
        reach_points_coop,
        reach_values_coop,
        )
        
    saved_reach_data2 = reach_counts(
        saved_reach_data2,
        arch_bricks.Branch(i),
        reach_points_single,
        reach_values_single,
        )
    
    saved_variables["angle"] = arch_dims.Branch(i)[0]
    saved_variables["span"] = arch_dims.Branch(i)[1]
    saved_variables["ratio"] = arch_dims.Branch(i)[2]
    
    output["arch_info"] = saved_variables
    output["reach_data_coop"] = saved_reach_data1
    output["reach_data_single"] = saved_reach_data2
    output["analysis_data"] = {} #just initialize this, populate in other
    
#    print output

    if save_data:
        save_json(saved_variables, output)
# ---------- end python_9 ----------

# ----
# STEP 5: choose what % of arch structure to analyze.
# select subset of curve for analysis
# what % of arch to build
# bricks represented as their centerlines
list_5 = ValueList({"25%": 0.25, "50%": 0.50, "75%": 0.75, "100%": 1.00}, selected="75%")
crv_12 = Curve(shatter)
lng = ListLength(List=crv_12)
multiplication_4 = Multiplication(A=lng, B=list_5)
end = EndPoints(Curve=crv_12)  # -> Start, End
round = Round(Number=multiplication_4)  # -> Nearest, Floor, Ceiling
dom = ConstructDomain(DomainStart=0, DomainEnd=expr("x-1", round.Nearest))
panel_23 = Panel(dom)
pt_12 = Point(end.Start)
pt_13 = Point(end.End)
subset = SubList(List=pt_12, Domain=dom, Wrap=True)  # -> List, Index
subset_2 = SubList(List=pt_13, Domain=dom, Wrap=True)  # -> List, Index
subset_3 = SubList(List=pt_12, Domain=dom, Wrap=True)  # -> List, Index
shift = ShiftList(List=subset_3.List, Shift=1, Wrap=False)  # -> simplify(List)
item_2 = ListItem(List=subset.List, Index=0, Wrap=True)  # -> simplify(Item)
item_3 = ListItem(List=subset_2.List, Index=-1, Wrap=True)  # -> simplify(Item)
ln = Line(StartPoint=subset_3.List, EndPoint=subset_2.List)  # -> simplify(Line)
crv_13 = Curve(ln)
pt_14 = Point(item_2)
pt_15 = Point(item_3)
pt_16 = Point(shift)

# ----
# reorient inclined arch members
density_kn_m_3 = Panel("14")
# STEP 6: perform finite element structural analysis
# Elements
modulus_kn_cm_2 = Panel("3000")
number = Number(modulus_kn_cm_2)
number_2 = Number(height_m)
number_3 = Number(width_m)
division_6 = Division(A=number, B="2.5")
multiplication_5 = Multiplication(A=number_2, B=100)
multiplication_6 = Multiplication(A=number_3, B=100)
matprops = MaterialPropertiesKaramba3D(
    FamilyOfMaterial="bricks",
    Name="bricks",
    YoungsModulus_kN_cm2=number,
    InPlaneShearModulus_kN_cm2=division_6,
    TransverseShearModulus_kN_cm2=division_6,
    SpecificWeight_kN_m3=density_kn_m_3,
    CoefficientOfThermalExpansion_1_C=1.2e-05,
    TensileStrength_kN_cm2=23.5,
    CompressiveStrength_kN_cm2=-23.5,
    StrengthHypothesis="MISES",
    mode="Isotrop")
height_cm = Panel(multiplication_5)
width_cm = Panel(multiplication_6)
material = MaterialKaramba3D(matprops)
cross_section = CrossSectionKaramba3D(
    FamilyNameOfCrossSection="DefaultCroSec",
    Material=material,
    Height_cm=height_cm,
    UpperFlangeWidth_cm=width_cm,
    LowerFlangeWidth_cm=width_cm,
    mode="Trapezoid")
pln_2 = Plane(pln)
deplane = DeconstructPlane(Plane=pln_2)  # -> Origin, XAxis, YAxis, ZAxis
crosec = CrossSectionKaramba3D(cross_section)

# ----
# support node force 1/2 of normal node force
data_17 = Data(height_m)
data_18 = Data(width_m)
data_19 = Data(thickness_m)
# Loads
data_20 = Data(density_kn_m_3)
multiplication_7 = Multiplication(A=data_17, B=data_18, C=data_19)
multiplication_8 = Multiplication(A=data_20, B=multiplication_7)
applied_load_kn = Panel(multiplication_8)
Z = UnitZ(Factor=expr("-x", applied_load_kn))
scale_up_self_weight = Panel("1")
multiplication_9 = Multiplication(A=Z, B=scale_up_self_weight)
division_7 = Division(A=multiplication_9, B="2")

# ----
# Nodes
# if you want to align supports with a plane
panel_24 = Panel("end supports")
pln_3 = Plane(pln)
panel_25 = Panel("brick nodes")
pt_17 = Point(pt_15)
pt_18 = Point(pt_14)
pt_19 = Point(pt_16)
item_4 = ListItem(List=pln_3, Index=-1, Wrap=True)  # -> Item, Item1
deplane_2 = DeconstructPlane(Plane=item_4.Item)  # -> Origin, XAxis, YAxis, ZAxis
pl_2 = ConstructPlane(Origin=deplane_2.Origin, XAxis=expr("-x", deplane_2.XAxis), YAxis=deplane_2.YAxis)

panel_26 = Panel("other nodes")
panel_27 = Panel("support nodes")
pt_20 = Point(pt_15)
pt_21 = Point(pt_16)
pt_22 = Point(pt_14)

pln_4 = Plane(item_4.Item1)
pt_23 = Point(pt_18)
pt_24 = Point(pt_17)
pln_5 = Plane(pl_2)
pt_25 = Point(pt_19)
supp = SupportKaramba3D(PosInd=pt_23, menu=[buttons(on, on, on, on, on, off)])
supp_2 = SupportKaramba3D(PosInd=pt_24, menu=[buttons(on, on, on, off, off, off)])
supp_3 = SupportKaramba3D(PosInd=pt_25, menu=[buttons(off, off, off, off, off, off)])
support = SupportKaramba3D(simplify(supp))
support_2 = SupportKaramba3D(simplify(supp_2))
support_3 = SupportKaramba3D(simplify(supp_3))
merge = Merge(Data1=support, Data2=support_2)

vec_5 = Vector(multiplication_9)
pt_26 = Point(pt_21)
vec_6 = Vector(division_7)
pt_27 = Point([pt_22, pt_20])
loads = LoadsKaramba3D(Vector=Vector(0, 0, -1), LCase="0", mode="Gravity")
loads_2 = LoadsKaramba3D(ForceVector=vec_6, Local=False, PosInd=pt_27, LCase="0", mode="Point")
loads_3 = LoadsKaramba3D(ForceVector=vec_5, Local=False, PosInd=pt_26, LCase="0", mode="Point")
load = LoadKaramba3D(simplify(loads_2))
load_2 = LoadKaramba3D(simplify(loads_3))
load_3 = LoadKaramba3D(loads)
merge_2 = Merge(Data2=load, Data3=load_2)

crosec_2 = CrossSectionKaramba3D(crosec)
crv_14 = Curve(crv_13)
vec_7 = Vector(deplane.XAxis)
linetobeam = LineToBeamKaramba3D(
    Line=crv_14,
    Identifier="bricks",
    CrossSection=crosec_2,
    New=True,
    Remove=True,
    LimitDistance_m=0.005,
    ZOrientation=vec_7,
    Bending=True,
    SetBucklingLength=True,
    ToPolylineMaxAngle=0.03,
    ToPolylineTolerance=0.01,
    ToPolylineMinEdgeLength=0.25)  # -> Element, Points, Info
element = ElementKaramba3D(simplify(linetobeam.Element))

# ----
# Perform Analysis
element_2 = ElementKaramba3D(element)
support_4 = SupportKaramba3D(merge)
load_4 = LoadKaramba3D(merge_2)
joint_2 = JointKaramba3D(joint)
assemble = AssembleModelKaramba3D(Elem=element_2, Support=support_4, Load=load_4, Joint=joint_2, LimitDistance_m=0.005)  # -> Model, Info, Mass_kg, CenterOfGravity, LoadCaseNames
analyze = AnalyzeKaramba3D(Model=assemble.Model)  # -> CalculatedModel, simplify(MaximumDisplacement_cm), ResultingForceOfGravity_kN, ElasticEnergy_kNm
viewer_3 = ParamViewer(assemble.Mass_kg)
model = ModelKaramba3D(analyze.CalculatedModel)

# ----
# STEP 7: process structural analysis results and output
# process results
react = ReactionForcesKaramba3D(AnalyzedModel=model)  # -> AnalyzedModel, simplify(ReactionForces_kN), simplify(ReactionMoments_kNm), simplify(SupportPosition), simplify(SumOfReactionForces_kN), simplify(SumOfReactionMoments_kNm)
item_5 = ListItem(List=react.ReactionMoments_kNm, Index=0, Wrap=True)
item_6 = ListItem(List=react.ReactionForces_kN, Index=0, Wrap=True)  # -> Item, Item1

# ----
# Vizualize analyzed models
panel_28 = Panel("1")
modelview = ModelViewKaramba3D(Model=model, ResultFactors=panel_28, ResultCase=-1)  # -> Model, DeformedMesh, DeformedAxes, DeformedModel
beamview = BeamViewKaramba3D(Model=modelview.Model)  # -> Model, MeshesOfRenderedBeams, DeformedBeamAxes, LegendColors, LegendTags

vlen = VectorLength(Vector=item_6.Item)
vlen_2 = VectorLength(Vector=item_6.Item1)
multiplication_10 = Multiplication(A=vlen_2, B="1000")
multiplication_11 = Multiplication(A=vlen, B="1000")
division_8 = Division(A=multiplication_10, B="9.81")
division_9 = Division(A=multiplication_11, B="9.81")

data_21 = Data(item_5)
data_22 = Data(item_6.Item)
support_forces_kn = Panel(data_22)
support_moments_kn_m = Panel(data_21)

num_4 = Number(analyze.MaximumDisplacement_cm)
num_5 = Number(assemble.Mass_kg)
max_disp_cm = Panel(num_4)
total_mass_kg = Panel(num_5)

# ----
# results
num_6 = Number(division_9)
num_7 = Number(division_8)
robot_support_kg = Panel(num_7)
other_end_support_kg = Panel(num_6)

# ----
# output structural analysis results
panel_29 = Panel(list_5)
multiplication_12 = Multiplication(A=panel_29, B=100)
panel_30 = Panel(multiplication_12)
data_23 = Data(data_3)
data_24 = Data(num_4)
data_25 = Data(data_21)
data_26 = Data(split.Positive)
data_27 = Data(num_5)
data_28 = Data(num_7)
data_29 = Data(data_22)
python_10 = GhPythonScript(
    output_path=data_23,
    arch_dims=data_26,
    pcntg_complete=panel_30,
    mass=data_27,
    disp=data_24,
    rob_support_kg=data_28,
    rxn_force=data_29,
    rxn_moment=data_25,
    save_data=Toggle(False))  # -> out, output; inputs arch_dims: tree, pcntg_complete: Int32, mass: tree, disp: tree, rob_support_kg: tree, rxn_force: tree, rxn_moment: tree
# ---------- python_10: Python ----------
__author__ = "Edvard"
__version__ = "2023.06.13"

import rhinoscriptsyntax as rs
import ghpythonlib.treehelpers as th

import os
import json

from collections import OrderedDict

def generate_filename(data):
    name = "a{:0>3}_s{:0>2}_r{:0>3}"
    
    angle = str(int(data["angle"]*10))
    width = str(data["width"]).replace('.','')
    ratio = str(int(round(data["ratio"]*100,0))).replace('.','')
    
    filename = name.format(angle,width,ratio)
    return filename

def save_json(arch_dims,analysis_data,p):
    
    filename = generate_filename(arch_dims)
    filepath = os.path.join(output_path, filename)
    
    if where_json(filepath):
        print "file exists", filepath

        with open(filepath, "r") as f:
            data = json.loads(f.read(),object_pairs_hook=OrderedDict)
            data["analysis_data"]["{}%".format(pcntg_complete)] = analysis_data
            f.close()
    else:
        print "file does not exist"
    
    with open(filepath, "w") as f:
        json.dump(data,f,indent=4)
        f.close()

def where_json(file_name):
    return os.path.exists(file_name)

for i in range(arch_dims.BranchCount):
    
    saved_variables = OrderedDict()
    saved_analysis_data = OrderedDict()
    
    saved_variables["angle"] = arch_dims.Branch(i)[0]
    saved_variables["width"] = arch_dims.Branch(i)[1]
    saved_variables["ratio"] = arch_dims.Branch(i)[2]
    
    saved_analysis_data["mass_kg"] = float('%.2f' % (mass.Branch(i)[0]))
    saved_analysis_data["disp_cm"] = round(disp.Branch(i)[0],4)
    saved_analysis_data["rob_support_kg"] = float('%.2f' % (rob_support_kg.Branch(i)[0]))
    saved_analysis_data["rxn_force_kn"] = [round(x,2) for x in rxn_force.Branch(i)[0]]
    saved_analysis_data["rxn_mom_knm"] = [round(x,2) for x in rxn_moment.Branch(i)[0]]
    
    if save_data:
        save_json(saved_variables, saved_analysis_data, pcntg_complete)
# ---------- end python_10 ----------
